# Grasshopper definition GH_ClosestPointVector.gh (Grasshopper 1.0.7)

pt = Point(Point(432.8150297, 88.26015291, 0))
crv = Curve(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)
c__closestpoint = CSharpScript(curve_Closed=crv, point_IntheCurve=pt)  # -> out, A; inputs curve_Closed: Curve, point_IntheCurve: Point3d
# ---------- c__closestpoint: C# ----------
    A = ClosestPoint(curve_Closed, point_IntheCurve);
# ---------- c__closestpoint: C# additional code ----------
  static Point3d ClosestPoint(Curve curve_Closed, Point3d point_IntheCurve)
  {

    double par;

    curve_Closed.ClosestPoint(point_IntheCurve, out par);

    return curve_Closed.PointAt(par);;
  }
# ---------- end c__closestpoint ----------
c__vector_closestpoint = CSharpScript(curve_Closed=crv, point_BasePoint=pt)  # -> out, A; inputs curve_Closed: Curve, point_BasePoint: Point3d
# ---------- c__vector_closestpoint: C# ----------
    A = unitVector_closestPoint_BasePoint(curve_Closed, point_BasePoint);
# ---------- c__vector_closestpoint: C# additional code ----------
  static Point3d ClosestPoint(Curve curve_Closed, Point3d point_BasePoint)
  {

    double par;

    curve_Closed.ClosestPoint(point_BasePoint, out par);

    return curve_Closed.PointAt(par);;
  }

  static Vector3d unitVector_closestPoint_BasePoint(Curve curve_Closed, Point3d point_BasePoint)
  {

    Point3d second_Point = ClosestPoint(curve_Closed, point_BasePoint);

    Vector3d result_Vector = new Vector3d(second_Point.X - point_BasePoint.X, second_Point.Y - point_BasePoint.Y, second_Point.Z - point_BasePoint.Z);

    result_Vector.Unitize();

    return result_Vector;
  }
# ---------- end c__vector_closestpoint ----------
pl = PlaneNormal(Origin=c__closestpoint.A, ZAxis=c__vector_closestpoint.A)
